# Grasshopper definition Spoil Pile Test.gh (Grasshopper 1.0.7)
# plug-ins: Human, Kangaroo2 Components, Bifocals

curve = Curve([<curve referenced from the Rhino model> x2])

volume_of_excavation_cy = Slider(462, range=0..462)
expansion_coefficient = Slider(1.5, range=0..10)
tan_33_deg = Panel("0.64940759319")
cy_to_cu_in = Expression(x=volume_of_excavation_cy, Expression="x*46656")
expression = Expression(x=cy_to_cu_in, y=expansion_coefficient, z=tan_33_deg, Expression="3*x*y/3.14/z")
cube_root = CubeRoot(Value=expression)
multiplication = Multiplication(A=cube_root, B=tan_33_deg)
point = Point(Point(-2017.512653, -830.1341636, 0))
cone = Cone(Base=point, Radius=cube_root, Length=multiplication)  # -> Cone, Tip
cap_holes_ex = CapHolesEx(Brep=cone.Cone)  # -> Brep, Caps, Solid
volume = Volume(Geometry=cap_holes_ex.Brep)  # -> Volume, Centroid
bake_geometry = BakeGeometry(Bake=Button(), Geometry=cap_holes_ex.Brep, DeleteOldBakes=False, PreserveTrees=False)
expression_2 = Expression(x=volume.Volume, Expression="x/27/12/12/12")
panel = Panel(expression_2)

area = Area(Geometry=curve)  # -> Area, Centroid
curve_closest_point = CurveClosestPoint(Point=area.Centroid, Curve=curve)  # -> Point, Parameter, Distance
expression_3 = Expression(x=curve_closest_point.Distance, Expression="x*0.64940759319")
distance = Distance(PointA=curve_closest_point.Point, PointB=area.Centroid)
circle_cnr = CircleCNR(Center=area.Centroid, Normal=Vector(0, 0, 1), Radius=distance)
square_root = SquareRoot(Value=expression)
cone_2 = Cone(Base=curve, Radius=distance, Length=expression_3)  # -> Cone, Tip
cap_holes_ex_2 = CapHolesEx(Brep=cone_2.Cone)  # -> Brep, Caps, Solid
bake_geometry_2 = BakeGeometry(Bake=Button(), Geometry=cap_holes_ex_2.Brep, DeleteOldBakes=False, PreserveTrees=False)
brep = Brep(<brep referenced from the Rhino model>)
brep_2 = Brep([<brep referenced from the Rhino model> x3])
subd_fuse = SubDFuse(SubDA=brep, SubDB=brep_2, BooleanOption="0", Smoothing=10)
volume_2 = Volume(Geometry=subd_fuse)  # -> Volume, Centroid
panel_2 = Panel(volume_2.Volume)
bake_geometry_3 = BakeGeometry(Bake=Button(), DeleteOldBakes=False, PreserveTrees=False)
expression_4 = Expression(x=volume_2.Volume, Expression="x*2.14335e-5")
panel_3 = Panel(expression_4)
mass_addition = MassAddition(Input=panel_3)  # -> Result, PartialResults
expansion_coefficient_2 = Slider(1.5, range=0..10)
panel_4 = Panel(mass_addition.Result)
division = Division(A=panel_4, B=expansion_coefficient_2)
panel_5 = Panel(division)
